# Grasshopper definition bounds.ghx (Grasshopper 1.0.8)

panel = Panel("""1
2
3
4
5""")
path = FilePath("D:\Keon Chae\Workshop\HakLeeGHStudy\week_1\bounds.py")
python = GhPythonScript(X=panel)  # -> Out, A
bnd = Bounds(Numbers=panel)
py3 = Python3Script(script=path, N=panel, I=bnd)  # -> out, domain; inputs N: list; unedited script template
panel_2 = Panel(bnd)
panel_3 = Panel(py3.domain)
panel_4 = Panel(py3.out)
equals = Equality(FirstNumber=bnd, SecondNumber=py3.domain)  # -> Equality, Inequality
